# Dynamo graph Stadium_Bowl_Aisle_Step_R2024.dyn (Dynamo 2.17.0.3472)
# author: Sightline
# Sightline Precast Aisle Steps | Base version: Revit 2024.0 (Dynamo 2.17, CPython3). Run in the PROJECT. Places one precast aisle step per aisle per row from the "Aisle step pieces" sheet: instances of the "Precast Aisle Step" family when loaded, otherwise exact DirectShape solids. Re-running replaces the previous pieces.

n1_sightline_workbook_xlsx = Filename("Choose the Sightline .xlsx")  # "1. Sightline workbook (.xlsx)"; graph input
n2_family_name = StringInput("Precast Aisle Step")  # "2. Family name"; graph input
n3_build_every_piece_as = BoolSelector(false)  # "3. Build every piece as DirectShape"; graph input
place_precast_aisle_steps = Python(IN[0]=n1_sightline_workbook_xlsx, IN[1]=n2_family_name, IN[2]=n3_build_every_piece_as)  # CPython3
# ---------- place_precast_aisle_steps.python (241 lines) ----------
# Sightline Precast Aisle Steps  |  Dynamo 2.17 (CPython3)  |  Base version Revit 2024.0
# Places one precast aisle step per aisle per row in the PROJECT, from the "Aisle step pieces" sheet of a Sightline workbook:
#   a one-step is a rectangular block, a two-step an L-shaped block, sitting on the bowl tread against the riser of the row above.
# With the "Precast Aisle Step" family loaded, each piece is an instance of it (parameters Width, Tread, Riser, Steps, Bend Angle;
# see Stadium_Bowl_Aisle_Step_Family_Spec.txt). Pieces the family cannot take (a bend, when it has no Bend Angle parameter), or every piece when
# the family is not loaded, are built as exact DirectShape solids (Generic Models) from the "Aisle steps" plates.
# Coordinates: Sightline origin (field centre at pitch level) = project internal origin, the same as the bowl family placed there.
# Inputs: IN[0] Sightline workbook (.xlsx)  IN[1] Family name  IN[2] Build every piece as DirectShape (ignore the family)
import clr, math, re, os, zipfile
import xml.etree.ElementTree as ET
clr.AddReference('RevitAPI')
from Autodesk.Revit.DB import *
from Autodesk.Revit.DB.Structure import StructuralType
clr.AddReference('RevitServices')
from RevitServices.Persistence import DocumentManager
from RevitServices.Transactions import TransactionManager
clr.AddReference('System')
from System.Collections.Generic import List

MM = 1.0 / 304.8                       # Revit works in feet
TAG = 'Sightline aisle step'
NS = '{http://schemas.openxmlformats.org/spreadsheetml/2006/main}'
RID = '{http://schemas.openxmlformats.org/officeDocument/2006/relationships}id'
TIER_COLOURS = [(150, 150, 150), (110, 140, 180), (185, 135, 95)]


class Stop(Exception):
    pass


# ---------- Excel, read with the standard library (no Excel install needed) ----------
def col_of(ref):
    n = 0
    for ch in ref:
        if not ch.isalpha():
            break
        n = n * 26 + ord(ch.upper()) - 64
    return n - 1


def read_xlsx(p):
    with zipfile.ZipFile(p) as z:
        names = set(z.namelist())
        shared = []
        if 'xl/sharedStrings.xml' in names:
            for si in ET.fromstring(z.read('xl/sharedStrings.xml')).iter(NS + 'si'):
                shared.append(''.join(t.text or '' for t in si.iter(NS + 't')))
        rels = {r.get('Id'): r.get('Target') for r in ET.fromstring(z.read('xl/_rels/workbook.xml.rels'))}
        book = {}
        for sh in ET.fromstring(z.read('xl/workbook.xml')).iter(NS + 'sheet'):
            t = (rels.get(sh.get(RID)) or '').replace('\\', '/')
            t = t[1:] if t.startswith('/') else (t if t.startswith('xl/') else 'xl/' + t)
            if t not in names:
                continue
            rows = []
            for row in ET.fromstring(z.read(t)).iter(NS + 'row'):
                vals = []
                for c in row.iter(NS + 'c'):
                    i = col_of(c.get('r')) if c.get('r') else len(vals)
                    while len(vals) < i:
                        vals.append(None)
                    typ, v = c.get('t'), c.find(NS + 'v')
                    if typ == 's':
                        val = shared[int(v.text)]
                    elif typ == 'inlineStr':
                        val = ''.join(x.text or '' for x in c.iter(NS + 't'))
                    elif typ in ('str', 'e'):
                        val = v.text if v is not None else ''
                    elif typ == 'b':
                        val = v is not None and v.text == '1'
                    else:
                        val = float(v.text) if v is not None and v.text not in (None, '') else None
                    vals.append(val)
                rows.append(vals)
            book[sh.get('name')] = rows
    return book


def num(v):
    try:
        return float(v)
    except (TypeError, ValueError):
        return None




def sheet(book, name):
    rows = book.get(name, [])
    if not rows:
        return [], []
    head = [str(h or '').strip() for h in rows[0]]
    return head, [list(r) + [None] * 80 for r in rows[1:] if r and num(r[0]) is not None]


def col(head, name):
    for i, h in enumerate(head):
        if h.lower().startswith(name.lower()):
            return i
    raise Stop('Column "%s" missing: re-export the workbook from Sightline.' % name)


def set_param(e, names, value):
    for n in names:
        p = e.LookupParameter(n)
        if p is not None and not p.IsReadOnly:
            try:
                if p.StorageType == StorageType.Integer:
                    p.Set(int(round(value)))
                elif p.StorageType == StorageType.Double:
                    p.Set(float(value))
                else:
                    p.Set(str(value))
                return True
            except Exception:
                pass
    return False


def plate_solid(pts, z0, z1):
    q = []
    for x, y in pts:
        if not q or math.hypot(x - q[-1][0], y - q[-1][1]) > 0.5:
            q.append((x, y))
    while len(q) > 2 and math.hypot(q[0][0] - q[-1][0], q[0][1] - q[-1][1]) <= 0.5:
        q.pop()
    loop = CurveLoop()
    p3 = [XYZ(x * MM, y * MM, z0 * MM) for x, y in q]
    for i in range(len(p3)):
        loop.Append(Line.CreateBound(p3[i], p3[(i + 1) % len(p3)]))
    if loop.IsCounterclockwise(XYZ.BasisZ) is False:
        loop.Flip()
    loops = List[CurveLoop]()
    loops.Add(loop)
    return GeometryCreationUtilities.CreateExtrusionGeometry(loops, XYZ.BasisZ, (z1 - z0) * MM)


def main(path, fam_name, force_ds):
    doc = DocumentManager.Instance.CurrentDBDocument
    if doc is None or doc.IsFamilyDocument:
        raise Stop('Run this in the project (with the bowl family placed at the internal origin), not in a family.')
    book = read_xlsx(str(path))
    head, pieces = sheet(book, 'Aisle step pieces')
    if not pieces:
        raise Stop('No "Aisle step pieces" sheet: export again from Sightline (computed aisle layout, imperial).')
    phead, plates = sheet(book, 'Aisle steps')
    c = dict((k, col(head, k)) for k in ('Piece', 'Tier', 'Zone', 'Aisle', 'Row', 'Steps', 'Riser', 'Tread', 'Width', 'Bend', 'X (', 'Y (', 'Z (', 'Rotation'))
    pc = dict((k, col(phead, k)) for k in ('Piece', 'Z bottom', 'Z top', 'Corners')) if plates else {}
    by_piece = {}
    for r in plates:
        n = int(num(r[pc['Corners']]) or 0)
        v = [num(x) for x in r[pc['Corners'] + 1:pc['Corners'] + 1 + 2 * n]]
        if n >= 3 and all(x is not None for x in v):
            by_piece.setdefault(int(num(r[pc['Piece']])), []).append(([(v[2 * i], v[2 * i + 1]) for i in range(n)], num(r[pc['Z bottom']]), num(r[pc['Z top']])))

    sym = None
    if not force_ds:
        for s in FilteredElementCollector(doc).OfClass(FamilySymbol):
            if s.Family is not None and s.Family.Name == fam_name:
                sym = s
                break
    has_bend = False
    stats = {'fam': 0, 'ds': 0, 'fail': 0, 'removed': 0, 'err': ''}
    TransactionManager.Instance.EnsureInTransaction(doc)
    try:
        old = []                                                # re-run replaces, never stacks
        for e in FilteredElementCollector(doc).WhereElementIsNotElementType():
            p = e.get_Parameter(BuiltInParameter.ALL_MODEL_INSTANCE_COMMENTS)
            if p is not None and p.AsString() == TAG:
                old.append(e.Id)
        for i in old:
            try:
                doc.Delete(i)
                stats['removed'] += 1
            except Exception:
                pass
        if sym is not None:
            if not sym.IsActive:
                sym.Activate()
                doc.Regenerate()
        gm = ElementId(BuiltInCategory.OST_GenericModel)
        for r in pieces:
            i = int(num(r[c['Piece']]))
            mark = 'T%d %s A%d R%d' % (int(num(r[c['Tier']])), r[c['Zone']], int(num(r[c['Aisle']])), int(num(r[c['Row']])))
            bend = num(r[c['Bend']]) or 0.0
            try:
                e = None
                if sym is not None:
                    if True:
                        pt = XYZ(num(r[c['X (']]) * MM, num(r[c['Y (']]) * MM, num(r[c['Z (']]) * MM)
                        e = doc.Create.NewFamilyInstance(pt, sym, StructuralType.NonStructural)
                        ok = set_param(e, ['Width'], num(r[c['Width']]) * MM) and set_param(e, ['Tread'], num(r[c['Tread']]) * MM) \
                            and set_param(e, ['Riser'], num(r[c['Riser']]) * MM) and set_param(e, ['Steps'], num(r[c['Steps']]))
                        bok = abs(bend) < 0.01 or set_param(e, ['Bend Angle', 'Bend angle'], math.radians(bend))
                        if not (ok and bok):
                            doc.Delete(e.Id)
                            e = None
                        else:
                            ElementTransformUtils.RotateElement(doc, e.Id, Line.CreateUnbound(pt, XYZ.BasisZ), math.radians(num(r[c['Rotation']])))
                            stats['fam'] += 1
                if e is None:                                   # exact solid from the plates
                    sol = None
                    for pts, z0, z1 in by_piece.get(i, []):
                        s = plate_solid(pts, z0, z1)
                        sol = s if sol is None else BooleanOperationsUtils.ExecuteBooleanOperation(sol, s, BooleanOperationsType.Union)
                    if sol is None:
                        raise Exception('no plates for piece %d' % i)
                    e = DirectShape.CreateElement(doc, gm)
                    shp = List[GeometryObject]()
                    shp.Add(sol)
                    e.SetShape(shp)
                    try:
                        e.Name = 'Precast aisle step'
                    except Exception:
                        pass
                    stats['ds'] += 1
                set_param(e, ['Comments'], TAG)
                set_param(e, ['Mark'], mark)
            except Exception as ex:
                stats['fail'] += 1
                if not stats['err']:
                    stats['err'] = '%s: %s' % (mark, ex)
    finally:
        TransactionManager.Instance.TransactionTaskDone()

    lines = ['Placed %d precast aisle steps: %d family instances of "%s", %d DirectShape solids.' % (
        stats['fam'] + stats['ds'], stats['fam'], fam_name, stats['ds'])]
    if sym is None and not force_ds:
        lines.append('Family "%s" is not loaded, so every piece is a DirectShape. Load it (see Stadium_Bowl_Aisle_Step_Family_Spec.txt) and run again for family instances.' % fam_name)
    if stats['removed']:
        lines.append('Replaced %d elements from the previous run.' % stats['removed'])
    if stats['fail']:
        lines.append('WARNING: %d pieces failed. First: %s' % (stats['fail'], stats['err']))
    lines.append('Each piece: Comments = "%s", Mark = tier, stand, aisle, row. Origin = field centre at pitch level (project internal origin).' % TAG)
    return '\n'.join(lines)


try:
    OUT = main(IN[0], str(IN[1] or 'Precast Aisle Step'), bool(IN[2]))
except Stop as e:
    OUT = 'Stopped: ' + str(e)
# ----------------------------------------
result = Watch(place_precast_aisle_steps)  # graph output
