# Dynamo graph Stadium_Bowl_Mass_Revit_R2024.dyn (Dynamo 2.17.0.3472)
# author: Sightline
# Sightline Bowl Mass | Base version: Revit 2024.0 (Dynamo 2.17, CPython3). Builds each stand (tier x side) of a Sightline bowl in the family, one subcategory per stand; chamfered corners are built from the Corner plates sheet; open corners are gaps between stands. The preview node also shows it in Dynamo 3D (metres). Run in a new Metric Generic Model family.

n1_sightline_workbook_xlsx = Filename("Choose the Sightline .xlsx")  # "1. Sightline workbook (.xlsx)"; graph input
n2_mass_category_for_mass_floors = BoolSelector(false)  # "2. Mass category (for mass floors)"; graph input
n3_draw_focal_boundary_lines = BoolSelector(true)  # "3. Draw focal boundary lines"; graph input
build_sightline_bowl = Python(IN[0]=n1_sightline_workbook_xlsx, IN[1]=n2_mass_category_for_mass_floors, IN[2]=n3_draw_focal_boundary_lines)  # CPython3
# ---------- build_sightline_bowl.python (492 lines) ----------
# Sightline Bowl Mass  |  Dynamo 2.17 (CPython3)  |  Revit 2024
# Builds every stand (tier x side) of a Sightline bowl option inside the open family:
#   straight runs of the focal boundary  -> extrusion of the tier profile
#   corners and curves                   -> revolve of the profile about a vertical axis
# Each stand has its own profile; open corners are simply gaps between stands. Seat counts match Sightline.
# Base version: Revit 2024.0 (Dynamo 2.17). Reads Bowl pieces (zoned exports) or, for older exports, Tier N profile + Focal path.
# Inputs: IN[0] Sightline workbook (.xlsx)  IN[1] Mass category  IN[2] Draw focal boundary lines
import clr, math, re, os, zipfile
import xml.etree.ElementTree as ET
clr.AddReference('RevitAPI')
from Autodesk.Revit.DB import *
clr.AddReference('RevitServices')
from RevitServices.Persistence import DocumentManager
from RevitServices.Transactions import TransactionManager

MM = 1.0 / 304.8                       # Revit works in feet
NS = '{http://schemas.openxmlformats.org/spreadsheetml/2006/main}'
RID = '{http://schemas.openxmlformats.org/officeDocument/2006/relationships}id'
TIER_COLOURS = [(150, 150, 150), (110, 140, 180), (185, 135, 95)]


class Stop(Exception):
    pass


# ---------- Excel, read with the standard library (no Excel install needed) ----------
def col_of(ref):
    n = 0
    for ch in ref:
        if not ch.isalpha():
            break
        n = n * 26 + ord(ch.upper()) - 64
    return n - 1


def read_xlsx(p):
    with zipfile.ZipFile(p) as z:
        names = set(z.namelist())
        shared = []
        if 'xl/sharedStrings.xml' in names:
            for si in ET.fromstring(z.read('xl/sharedStrings.xml')).iter(NS + 'si'):
                shared.append(''.join(t.text or '' for t in si.iter(NS + 't')))
        rels = {r.get('Id'): r.get('Target') for r in ET.fromstring(z.read('xl/_rels/workbook.xml.rels'))}
        book = {}
        for sh in ET.fromstring(z.read('xl/workbook.xml')).iter(NS + 'sheet'):
            t = (rels.get(sh.get(RID)) or '').replace('\\', '/')
            t = t[1:] if t.startswith('/') else (t if t.startswith('xl/') else 'xl/' + t)
            if t not in names:
                continue
            rows = []
            for row in ET.fromstring(z.read(t)).iter(NS + 'row'):
                vals = []
                for c in row.iter(NS + 'c'):
                    i = col_of(c.get('r')) if c.get('r') else len(vals)
                    while len(vals) < i:
                        vals.append(None)
                    typ, v = c.get('t'), c.find(NS + 'v')
                    if typ == 's':
                        val = shared[int(v.text)]
                    elif typ == 'inlineStr':
                        val = ''.join(x.text or '' for x in c.iter(NS + 't'))
                    elif typ in ('str', 'e'):
                        val = v.text if v is not None else ''
                    elif typ == 'b':
                        val = v is not None and v.text == '1'
                    else:
                        val = float(v.text) if v is not None and v.text not in (None, '') else None
                    vals.append(val)
                rows.append(vals)
            book[sh.get('name')] = rows
    return book


def num(v):
    try:
        return float(v)
    except (TypeError, ValueError):
        return None


def seg_of(t, r):
    if t == 'LINE':
        return ('LINE', num(r[0]), num(r[1]), num(r[2]), num(r[3]))
    if t == 'ARC':
        return ('ARC', num(r[4]), num(r[5]), num(r[6]), num(r[7]), num(r[8]))
    return None


def profile_pts(rows):
    return [(num(r[1]), num(r[2])) for r in rows[1:] if len(r) >= 3 and num(r[1]) is not None and num(r[2]) is not None]


def load(p):
    """-> summary, stands: list of (tier, zone, profile points, [segments]) in build order."""
    if not p or not os.path.isfile(str(p)):
        raise Stop('Pick the workbook you exported from Sightline (Revit package).')
    try:
        book = read_xlsx(str(p))
    except Exception as e:
        raise Stop('Could not read that file as an Excel workbook: %s' % e)
    summary = {}
    for r in book.get('Summary', []):
        if len(r) >= 2 and r[0] not in (None, '') and not isinstance(r[0], float):
            summary[str(r[0]).strip()] = r[1]
    stands, order = {}, []
    if 'Bowl pieces' in book:                                   # zoned export: every stand has its own profile
        for r in book['Bowl pieces'][1:]:
            r = list(r) + [None] * 16
            t = str(r[4] or '').strip().upper()
            seg = seg_of(t, r[5:14])
            if seg is None:
                continue
            if any(v is None for v in seg[1:]):
                raise Stop('Bowl pieces row %s is incomplete.' % r[0])
            key = (int(num(r[1]) or 0), str(r[2]).strip(), str(r[3]).strip())
            if key not in stands:
                stands[key] = []
                order.append(key)
            stands[key].append(seg)
        out = []
        for tier, zone, sheet in order:
            if sheet not in book:
                raise Stop('Profile sheet "%s" is missing from the workbook.' % sheet)
            out.append((tier, zone, profile_pts(book[sheet]), stands[(tier, zone, sheet)]))
    else:                                                       # older export: one profile per tier, all the way round
        if 'Focal path' not in book:
            raise Stop('This workbook has no Bowl pieces or Focal path sheet. Open Sightline and download the Revit package again.')
        segs = []
        for r in book['Focal path'][1:]:
            r = list(r) + [None] * 12
            seg = seg_of(str(r[1] or '').strip().upper(), r[2:11])
            if seg is not None and all(v is not None for v in seg[1:]):
                segs.append(seg)
        out = []
        for name, rows in book.items():
            m = re.match(r'^Tier (\d+) profile$', name.strip())
            if m:
                out.append((int(m.group(1)), 'All', profile_pts(rows), segs))
        out.sort(key=lambda x: x[0])
    if not out:
        raise Stop('No stands found in this workbook. Is this a Sightline export?')
    return summary, out


# ---------- geometry ----------
def clean(pts):
    """Drop repeated points, the closing duplicate and collinear midpoints; Revit rejects lines under ~1 mm."""
    out = []
    for p in pts:
        if not out or math.hypot(p[0] - out[-1][0], p[1] - out[-1][1]) > 1.0:
            out.append(p)
    while len(out) > 2 and math.hypot(out[0][0] - out[-1][0], out[0][1] - out[-1][1]) <= 1.0:
        out.pop()
    i = 0
    while len(out) > 3 and i < len(out):
        a, b, c = out[i - 1], out[i], out[(i + 1) % len(out)]
        cr = (b[0] - a[0]) * (c[1] - b[1]) - (b[1] - a[1]) * (c[0] - b[0])
        if abs(cr) < 1e-6 * math.hypot(b[0] - a[0], b[1] - a[1]) * math.hypot(c[0] - b[0], c[1] - b[1]) + 1e-9:
            out.pop(i)
            i = max(i - 1, 0)
        else:
            i += 1
    return out


def ends_of(s):
    if s[0] == 'LINE':
        return (s[1], s[2]), (s[3], s[4])
    cx, cy, r, a0, sw = s[1:]
    a, b = math.radians(a0), math.radians(a0 + sw)
    return (cx + r * math.cos(a), cy + r * math.sin(a)), (cx + r * math.cos(b), cy + r * math.sin(b))


def stand_gap(segs):
    """Largest break between consecutive pieces of one stand (mm). A closed ring is also checked end to start."""
    e = [ends_of(s) for s in segs]
    gaps = [math.hypot(e[i][0][0] - e[i - 1][1][0], e[i][0][1] - e[i - 1][1][1]) for i in range(1, len(e))]
    turn = sum(s[5] for s in segs if s[0] == 'ARC')
    if abs(turn - 360) < 1:
        gaps.append(math.hypot(e[0][0][0] - e[-1][1][0], e[0][0][1] - e[-1][1][1]))
    return max(gaps) if gaps else 0.0


def focal_segs(path, stands):
    try:
        book = read_xlsx(str(path))
        out = []
        for r in book.get('Focal path', [])[1:]:
            r = list(r) + [None] * 12
            seg = seg_of(str(r[1] or '').strip().upper(), r[2:11])
            if seg is not None and all(v is not None for v in seg[1:]):
                out.append(seg)
        return out
    except Exception:
        return []


def load_plates(p):
    """Corner plates: list of (tier, zone, [(x,y)...], z0, z1) in mm."""
    try:
        book = read_xlsx(str(p))
    except Exception:
        return []
    rows = book.get('Corner plates', [])
    if not rows:
        return []
    head = [str(h or '') for h in rows[0]]
    out = []
    for r in rows[1:]:
        r = list(r) + [None] * 40
        if num(r[0]) is None:
            continue
        if len(head) > 5 and head[5].startswith('Corners'):                 # Plate, Tier, Zone, Z0, Z1, Corners, X1, Y1, ...
            n = int(num(r[5]) or 0)
            v = [num(x) for x in r[6:6 + 2 * n]]
            z0, z1 = num(r[3]), num(r[4])
        else:                                                               # older: X1..Y4 then Z bottom, Z top
            n, v = 4, [num(x) for x in r[3:11]]
            z0, z1 = num(r[11]), num(r[12])
        if n < 3 or z0 is None or z1 is None or any(x is None for x in v):
            continue
        out.append((int(num(r[1])), str(r[2]).strip(), [(v[2 * i], v[2 * i + 1]) for i in range(n)], z0, z1))
    return out


def build_plate(doc, pts, z0, z1, sub, stats):
    if z1 - z0 < 1:
        return
    q = []
    for p in pts:                                          # the chamfer starts at a point: drop repeated corners
        if not q or math.hypot(p[0] - q[-1][0], p[1] - q[-1][1]) > 1:
            q.append(p)
    while len(q) > 2 and math.hypot(q[0][0] - q[-1][0], q[0][1] - q[-1][1]) <= 1:
        q.pop()
    if len(q) < 3:
        return
    try:
        p3 = [XYZ(x * MM, y * MM, z0 * MM) for x, y in q]
        sp = SketchPlane.Create(doc, Plane.CreateByNormalAndOrigin(XYZ(0, 0, 1), XYZ(0, 0, z0 * MM)))
        f = doc.FamilyCreate.NewExtrusion(True, curve_loop(p3), sp, (z1 - z0) * MM)
        stats['plate'] += 1
        try:
            f.Subcategory = sub
        except Exception:
            pass
    except Exception as e:
        stats['fail'] += 1
        if not stats['err']:
            stats['err'] = 'corner plate: %s' % e


def curve_loop(p3):
    ca = CurveArray()
    for i in range(len(p3)):
        ca.Append(Line.CreateBound(p3[i], p3[(i + 1) % len(p3)]))
    arr = CurveArrArray()
    arr.Append(ca)
    return arr


def build(doc, prof, segs, sub, stats):
    fc = doc.FamilyCreate
    for s in segs:
        try:
            if s[0] == 'LINE':
                x1, y1, x2, y2 = s[1:]
                L = math.hypot(x2 - x1, y2 - y1)
                if L < 5:
                    continue
                ux, uy = (x2 - x1) / L, (y2 - y1) / L
                nx, ny = uy, -ux                                  # outward: the loop runs counter-clockwise
                mx, my = (x1 + x2) / 2.0, (y1 + y2) / 2.0
                p3 = [XYZ((mx + nx * x) * MM, (my + ny * x) * MM, z * MM) for x, z in prof]
                sp = SketchPlane.Create(doc, Plane.CreateByNormalAndOrigin(XYZ(ux, uy, 0), XYZ(mx * MM, my * MM, 0)))
                f = fc.NewExtrusion(True, curve_loop(p3), sp, L / 2.0 * MM)
                f.StartOffset = -L / 2.0 * MM                     # symmetric about mid-edge, so direction can't flip
                stats['ext'] += 1
            else:
                cx, cy, r, a0, sw = s[1:]
                if sw < 0.05:
                    continue
                f = revolve(doc, prof, cx, cy, r, a0, sw, stats)
                stats['rev'] += 1
            try:
                f.Subcategory = sub
            except Exception:
                pass
        except Stop:
            raise
        except Exception as e:
            stats['fail'] += 1
            if not stats['err']:
                stats['err'] = '%s at %s: %s' % (s[0], tuple(round(v) for v in s[1:3]), e)


def revolve_at(doc, prof, cx, cy, r, ang, a, b):
    rx, ry = math.cos(math.radians(ang)), math.sin(math.radians(ang))
    p3 = [XYZ((cx + rx * (r + x)) * MM, (cy + ry * (r + x)) * MM, z * MM) for x, z in prof]
    C = XYZ(cx * MM, cy * MM, 0)
    sp = SketchPlane.Create(doc, Plane.CreateByNormalAndOrigin(XYZ(ry, -rx, 0), C))   # plane holds the axis and the radius
    axis = Line.CreateBound(C, XYZ(cx * MM, cy * MM, 10.0))
    return doc.FamilyCreate.NewRevolution(True, curve_loop(p3), sp, axis, a, b)


def revolve(doc, prof, cx, cy, r, a0, sw, stats):
    h = math.radians(sw) / 2.0
    if stats['mode'] == 'sym':                                   # profile at mid-angle, -h..+h: direction-proof
        try:
            return revolve_at(doc, prof, cx, cy, r, a0 + sw / 2.0, -h, h)
        except Exception:
            stats['mode'] = sense(doc)
    start = a0 if stats['mode'] == 'ccw' else a0 + sw
    return revolve_at(doc, prof, cx, cy, r, start, 0.0, 2 * h)


def sense(doc):
    """Fallback if negative start angles are refused: revolve a test square 90 degrees and see which way it went."""
    t, mode = None, 'ccw'
    try:
        t = revolve_at(doc, [(10000, 0), (11000, 0), (11000, 1000), (10000, 1000)], 0, 0, 0, 0, 0.0, math.pi / 2)
        doc.Regenerate()
        bb = t.get_BoundingBox(None)
        mode = 'ccw' if (bb.Min.Y + bb.Max.Y) / 2.0 > 0 else 'cw'
    except Exception:
        pass
    finally:
        if t is not None:
            try:
                doc.Delete(t.Id)
            except Exception:
                pass
    return mode


def subcategory(doc, parent, name, rgb):
    for c in parent.SubCategories:
        if c.Name == name:
            sub = c
            break
    else:
        sub = doc.Settings.Categories.NewSubcategory(parent, name)
    try:
        sub.LineColor = Color(*rgb)
    except Exception:
        pass
    return sub


def is_ours(el):
    try:
        sc = el.Subcategory
        if sc is not None and sc.Name.startswith('Sightline'):
            return True
    except Exception:
        pass
    try:
        return el.LineStyle.Name.startswith('Sightline')
    except Exception:
        return False


def set_text(doc, name, val):
    fm = doc.FamilyManager
    if fm.CurrentType is None:
        fm.NewType('Sightline')
    p = None
    for q in fm.GetParameters():
        if q.Definition.Name == name:
            p = q
    if p is None:
        p = fm.AddParameter(name, GroupTypeId.IdentityData, SpecTypeId.String.Text, False)
    fm.Set(p, str(val))


def main(path, as_mass, draw_path):
    doc = DocumentManager.Instance.CurrentDBDocument
    if doc is None or not doc.IsFamilyDocument:
        raise Stop('Run this in a family, not the project: File > New > Family > Metric Generic Model.rft, '
                   'save it, then run the graph.')
    fam = doc.OwnerFamily
    if getattr(fam, 'IsConceptualMassFamily', False):
        raise Stop('This is a conceptual mass family, which cannot hold extrusions and revolves. '
                   'Start from Metric Generic Model.rft instead and set "Mass category" to True.')
    cat = fam.FamilyCategory
    if cat is not None and 'profile' in cat.Name.lower():
        raise Stop('This is a profile family (for the Stadium_Bowl_Profile_R2024 graph). '
                   'For the whole bowl, start from Metric Generic Model.rft.')

    summary, stands = load(path)
    for tier, zone, prof, segs in stands:
        g = stand_gap(segs)
        if g > 50:
            raise Stop('Tier %d %s does not join up (gap %.0f mm). Re-export from Sightline.' % (tier, zone, g))

    stats = {'ext': 0, 'rev': 0, 'plate': 0, 'fail': 0, 'err': '', 'mode': 'sym', 'removed': 0, 'lines': 0}
    notes = []
    TransactionManager.Instance.EnsureInTransaction(doc)
    try:
        if as_mass:
            mcat = Category.GetCategory(doc, BuiltInCategory.OST_Mass)
            if cat is None or cat.Name != mcat.Name:
                fam.FamilyCategory = mcat
        cat = fam.FamilyCategory

        old = []                                                   # re-run replaces, never stacks
        for cls in (Extrusion, Revolution, CurveElement):
            old += [e.Id for e in FilteredElementCollector(doc).OfClass(cls) if is_ours(e)]
        for i in old:
            try:
                doc.Delete(i)
                stats['removed'] += 1
            except Exception:
                pass

        for tier, zone, pts, segs in stands:
            prof = clean(pts)
            if len(prof) < 3:
                notes.append('Tier %d %s profile has too few points; skipped.' % (tier, zone))
                continue
            try:                                               # one subcategory per stand: T2 E, T1 NEZ ...
                name = 'Sightline T%d %s' % (tier, zone) if zone != 'All' else 'Sightline Tier %d' % tier
                sub = subcategory(doc, cat, name, TIER_COLOURS[(tier - 1) % 3])
            except Exception:
                sub = None
            build(doc, prof, segs, sub, stats)
        for tier, zone, pts, z0, z1 in load_plates(path):          # chamfered corners
            try:
                sub = subcategory(doc, cat, 'Sightline T%d %s' % (tier, zone), TIER_COLOURS[(tier - 1) % 3])
            except Exception:
                sub = None
            build_plate(doc, pts, z0, z1, sub, stats)

        if draw_path:
            try:
                fsub = subcategory(doc, cat, 'Sightline Focal Boundary', (220, 0, 0))
                style = fsub.GetGraphicsStyle(GraphicsStyleType.Projection)
            except Exception:
                style = None
            sp0 = SketchPlane.Create(doc, Plane.CreateByNormalAndOrigin(XYZ.BasisZ, XYZ.Zero))
            for s in focal_segs(path, stands):
                try:
                    if s[0] == 'LINE':
                        c = Line.CreateBound(XYZ(s[1] * MM, s[2] * MM, 0), XYZ(s[3] * MM, s[4] * MM, 0))
                    elif s[3] > 1:
                        a0 = math.radians(s[4])
                        c = Arc.Create(XYZ(s[1] * MM, s[2] * MM, 0), s[3] * MM, a0, a0 + math.radians(s[5]), XYZ.BasisX, XYZ.BasisY)
                    else:
                        continue
                    ce = doc.FamilyCreate.NewSymbolicCurve(c, sp0)
                    if style is not None:
                        ce.LineStyle = style
                    stats['lines'] += 1
                except Exception:
                    pass
            if not stats['lines']:
                notes.append('Focal boundary lines are not allowed in this family type; the bowl was still built.')

        stamp = [('Sightline Option', summary.get('Sightline bowl option', '')),
                 ('Exported', summary.get('Exported', '')),
                 ('Sport', summary.get('Sport', '')),
                 ('Estimated Seats', int(num(summary.get('Estimated seats')) or 0)),
                 ('Tiers', len(set(t for t, _, _, _ in stands))),
                 ('Stands', ', '.join('T%d %s' % (t, z) for t, z, _, _ in stands)),
                 ('Source file', os.path.basename(str(path)))]
        for k, v in stamp:
            try:
                set_text(doc, k, v)
            except Exception:
                pass
    finally:
        TransactionManager.Instance.TransactionTaskDone()

    opt = str(summary.get('Sightline bowl option', 'Bowl'))
    seats = num(summary.get('Estimated seats'))
    nt = len(set(t for t, _, _, _ in stands))
    lines = ['Built %s: %s, %d tier%s in %d stand%s, %d extrusions + %d revolves + %d corner plates%s.' % (
        opt, summary.get('Sport', ''), nt, '' if nt == 1 else 's', len(stands), '' if len(stands) == 1 else 's', stats['ext'], stats['rev'], stats['plate'],
        ', %s seats (Sightline estimate)' % format(int(seats), ',') if seats else '')]
    if stats['removed']:
        lines.append('Replaced %d elements from the previous run.' % stats['removed'])
    if stats['fail']:
        lines.append('WARNING: %d pieces failed. First: %s' % (stats['fail'], stats['err']))
    lines += notes
    lines.append('Category: %s. Origin = field centre at pitch level.' % fam.FamilyCategory.Name)
    lines.append('Next: Save As Stadium_Bowl_Mass_Revit_R2024.rfa, Load into Project, place at the project origin (%s).' % re.sub(r'\W+', '', opt))
    return '\n'.join(lines)


try:
    OUT = main(IN[0], bool(IN[1]), bool(IN[2]))
except Stop as e:
    OUT = 'Stopped: ' + str(e)
# ----------------------------------------
result = Watch(build_sightline_bowl)  # graph output
preview_bowl_in_dynamo_metres = Python(IN[0]=n1_sightline_workbook_xlsx)  # CPython3
# ---------- preview_bowl_in_dynamo_metres.python (227 lines) ----------
# Sightline Bowl Preview  |  Dynamo 2.17 (CPython3)  |  Base version Revit 2024.0
# Draws every stand as Dynamo geometry in the 3D background preview, in METRES (Dynamo's preferred range;
# the Revit family itself is built full size by the main node). It does not touch the Revit model.
# IN[0] = Sightline workbook (.xlsx). Output: [stands grouped by tier, focal boundary curves]
import clr, math, re, os, zipfile
import xml.etree.ElementTree as ET
clr.AddReference('ProtoGeometry')
from Autodesk.DesignScript.Geometry import Point, Vector, PolyCurve, Solid, Line, Arc
M = 0.001
NS = '{http://schemas.openxmlformats.org/spreadsheetml/2006/main}'
RID = '{http://schemas.openxmlformats.org/officeDocument/2006/relationships}id'
class Stop(Exception):
    pass


# ---------- Excel, read with the standard library (no Excel install needed) ----------
def col_of(ref):
    n = 0
    for ch in ref:
        if not ch.isalpha():
            break
        n = n * 26 + ord(ch.upper()) - 64
    return n - 1


def read_xlsx(p):
    with zipfile.ZipFile(p) as z:
        names = set(z.namelist())
        shared = []
        if 'xl/sharedStrings.xml' in names:
            for si in ET.fromstring(z.read('xl/sharedStrings.xml')).iter(NS + 'si'):
                shared.append(''.join(t.text or '' for t in si.iter(NS + 't')))
        rels = {r.get('Id'): r.get('Target') for r in ET.fromstring(z.read('xl/_rels/workbook.xml.rels'))}
        book = {}
        for sh in ET.fromstring(z.read('xl/workbook.xml')).iter(NS + 'sheet'):
            t = (rels.get(sh.get(RID)) or '').replace('\\', '/')
            t = t[1:] if t.startswith('/') else (t if t.startswith('xl/') else 'xl/' + t)
            if t not in names:
                continue
            rows = []
            for row in ET.fromstring(z.read(t)).iter(NS + 'row'):
                vals = []
                for c in row.iter(NS + 'c'):
                    i = col_of(c.get('r')) if c.get('r') else len(vals)
                    while len(vals) < i:
                        vals.append(None)
                    typ, v = c.get('t'), c.find(NS + 'v')
                    if typ == 's':
                        val = shared[int(v.text)]
                    elif typ == 'inlineStr':
                        val = ''.join(x.text or '' for x in c.iter(NS + 't'))
                    elif typ in ('str', 'e'):
                        val = v.text if v is not None else ''
                    elif typ == 'b':
                        val = v is not None and v.text == '1'
                    else:
                        val = float(v.text) if v is not None and v.text not in (None, '') else None
                    vals.append(val)
                rows.append(vals)
            book[sh.get('name')] = rows
    return book


def num(v):
    try:
        return float(v)
    except (TypeError, ValueError):
        return None


def seg_of(t, r):
    if t == 'LINE':
        return ('LINE', num(r[0]), num(r[1]), num(r[2]), num(r[3]))
    if t == 'ARC':
        return ('ARC', num(r[4]), num(r[5]), num(r[6]), num(r[7]), num(r[8]))
    return None


def profile_pts(rows):
    return [(num(r[1]), num(r[2])) for r in rows[1:] if len(r) >= 3 and num(r[1]) is not None and num(r[2]) is not None]


def load(p):
    """-> summary, stands: list of (tier, zone, profile points, [segments]) in build order."""
    if not p or not os.path.isfile(str(p)):
        raise Stop('Pick the workbook you exported from Sightline (Revit package).')
    try:
        book = read_xlsx(str(p))
    except Exception as e:
        raise Stop('Could not read that file as an Excel workbook: %s' % e)
    summary = {}
    for r in book.get('Summary', []):
        if len(r) >= 2 and r[0] not in (None, '') and not isinstance(r[0], float):
            summary[str(r[0]).strip()] = r[1]
    stands, order = {}, []
    if 'Bowl pieces' in book:                                   # zoned export: every stand has its own profile
        for r in book['Bowl pieces'][1:]:
            r = list(r) + [None] * 16
            t = str(r[4] or '').strip().upper()
            seg = seg_of(t, r[5:14])
            if seg is None:
                continue
            if any(v is None for v in seg[1:]):
                raise Stop('Bowl pieces row %s is incomplete.' % r[0])
            key = (int(num(r[1]) or 0), str(r[2]).strip(), str(r[3]).strip())
            if key not in stands:
                stands[key] = []
                order.append(key)
            stands[key].append(seg)
        out = []
        for tier, zone, sheet in order:
            if sheet not in book:
                raise Stop('Profile sheet "%s" is missing from the workbook.' % sheet)
            out.append((tier, zone, profile_pts(book[sheet]), stands[(tier, zone, sheet)]))
    else:                                                       # older export: one profile per tier, all the way round
        if 'Focal path' not in book:
            raise Stop('This workbook has no Bowl pieces or Focal path sheet. Open Sightline and download the Revit package again.')
        segs = []
        for r in book['Focal path'][1:]:
            r = list(r) + [None] * 12
            seg = seg_of(str(r[1] or '').strip().upper(), r[2:11])
            if seg is not None and all(v is not None for v in seg[1:]):
                segs.append(seg)
        out = []
        for name, rows in book.items():
            m = re.match(r'^Tier (\d+) profile$', name.strip())
            if m:
                out.append((int(m.group(1)), 'All', profile_pts(rows), segs))
        out.sort(key=lambda x: x[0])
    if not out:
        raise Stop('No stands found in this workbook. Is this a Sightline export?')
    return summary, out


def clean(pts):
    """Drop repeated points, the closing duplicate and collinear midpoints; Revit rejects lines under ~1 mm."""
    out = []
    for p in pts:
        if not out or math.hypot(p[0] - out[-1][0], p[1] - out[-1][1]) > 1.0:
            out.append(p)
    while len(out) > 2 and math.hypot(out[0][0] - out[-1][0], out[0][1] - out[-1][1]) <= 1.0:
        out.pop()
    i = 0
    while len(out) > 3 and i < len(out):
        a, b, c = out[i - 1], out[i], out[(i + 1) % len(out)]
        cr = (b[0] - a[0]) * (c[1] - b[1]) - (b[1] - a[1]) * (c[0] - b[0])
        if abs(cr) < 1e-6 * math.hypot(b[0] - a[0], b[1] - a[1]) * math.hypot(c[0] - b[0], c[1] - b[1]) + 1e-9:
            out.pop(i)
            i = max(i - 1, 0)
        else:
            i += 1
    return out



def piece(prof, s):
    if s[0] == 'LINE':
        x1, y1, x2, y2 = s[1:]
        L = math.hypot(x2 - x1, y2 - y1)
        if L < 5:
            return None
        ux, uy = (x2 - x1) / L, (y2 - y1) / L
        nx, ny = uy, -ux
        pc = PolyCurve.ByPoints([Point.ByCoordinates((x1 + nx * x) * M, (y1 + ny * x) * M, z * M) for x, z in prof], True)
        return pc.ExtrudeAsSolid(Vector.ByCoordinates(ux, uy, 0), L * M)
    cx, cy, r, a0, sw = s[1:]
    if sw < 0.05:
        return None
    a = math.radians(a0 + sw / 2.0)                          # profile at mid-angle, revolve both ways
    rx, ry = math.cos(a), math.sin(a)
    pc = PolyCurve.ByPoints([Point.ByCoordinates((cx + rx * (r + x)) * M, (cy + ry * (r + x)) * M, z * M) for x, z in prof], True)
    return Solid.ByRevolve(pc, Point.ByCoordinates(cx * M, cy * M, 0), Vector.ZAxis(), -sw / 2.0, sw)


def preview(path):
    summary, stands = load(path)
    tiers, bad, n = {}, 0, 0
    for tier, zone, pts, segs in stands:
        prof = clean(pts)
        for s in segs:
            try:
                g = piece(prof, s)
                if g is not None:
                    tiers.setdefault(tier, []).append(g)
                    n += 1
            except Exception:
                bad += 1
    try:
        book = read_xlsx(str(path))
        rows = book.get('Corner plates', [])
        head = [str(h or '') for h in rows[0]] if rows else []
        for r in rows[1:]:
            r = list(r) + [None] * 40
            if num(r[0]) is None:
                continue
            if len(head) > 5 and head[5].startswith('Corners'):
                n = int(num(r[5]) or 0); v = [num(x) for x in r[6:6 + 2 * n]]; z0, z1 = num(r[3]), num(r[4])
            else:
                n, v = 4, [num(x) for x in r[3:11]]; z0, z1 = num(r[11]), num(r[12])
            if n < 3 or z0 is None or z1 is None or z1 - z0 < 1 or any(x is None for x in v):
                continue
            pc = PolyCurve.ByPoints([Point.ByCoordinates(v[2 * i] * M, v[2 * i + 1] * M, z0 * M) for i in range(n)], True)
            tiers.setdefault(int(num(r[1])), []).append(pc.ExtrudeAsSolid(Vector.ZAxis(), (z1 - z0) * M))
            n += 1
    except Exception:
        bad += 1
    focal = []
    for r in read_xlsx(str(path)).get('Focal path', [])[1:]:
        r = list(r) + [None] * 12
        s = seg_of(str(r[1] or '').strip().upper(), r[2:11])
        try:
            if s and s[0] == 'LINE':
                focal.append(Line.ByStartPointEndPoint(Point.ByCoordinates(s[1] * M, s[2] * M, 0), Point.ByCoordinates(s[3] * M, s[4] * M, 0)))
            elif s and s[3] > 1:
                focal.append(Arc.ByCenterPointRadiusAngle(Point.ByCoordinates(s[1] * M, s[2] * M, 0), s[3] * M, s[4], s[4] + s[5], Vector.ZAxis()))
        except Exception:
            pass
    return [tiers[k] for k in sorted(tiers)] + [focal], bad


try:
    geo, bad = preview(IN[0])
    OUT = geo
except Stop as e:
    OUT = 'Preview: ' + str(e)
except Exception as e:
    OUT = 'Preview failed: %s' % e
# ----------------------------------------
