# Dynamo graph Stadium_Bowl_Profile_R2024.dyn (Dynamo 2.17.0.3472)
# author: Sightline
# Sightline Profile Families | Base version: Revit 2024 (Dynamo 2.17+, CPython3). Makes one Revit profile family per tier (per tier and side when the sides differ) from the Sightline workbook's profile sheets, saves the .rfa files and loads them into the open project for Sweeps. Origin = point of focus, X away from the field, Y up. Family method after Jacob Small's Export-Profile-Family (Computational Dynamics). Run from a project (or any document with Load off).

n1_sightline_workbook_xlsx = Filename("Choose the Sightline .xlsx")  # "1. Sightline workbook (.xlsx)"; graph input
n2_profile_family_template_rft = Filename("C:\ProgramData\Autodesk\RVT 2024\Family Templates\English_I\Profile.rft")  # "2. Profile family template (.rft)"; graph input
n3_save_the_families_in = Directory("Choose a folder")  # "3. Save the families in"; graph input
n4_family_name_prefix = StringInput("Stadium_Bowl_Profile")  # "4. Family name prefix"; graph input
n5_load_into_the_open_project = BoolSelector(true)  # "5. Load into the open project"; graph input
sightline_profile_families = Python(IN[0]=n1_sightline_workbook_xlsx, IN[1]=n2_profile_family_template_rft, IN[2]=n3_save_the_families_in, IN[3]=n4_family_name_prefix, IN[4]=n5_load_into_the_open_project)  # CPython3
# ---------- sightline_profile_families.python (215 lines) ----------
# Sightline Profile Families  |  Dynamo 2.17+ (CPython3)  |  Revit 2024
# Makes one Revit profile family (.rfa) per tier (or per tier and side when the sides differ) from the profile sheets of
# the Sightline workbook (Revit package), saves it and loads it into the open project, ready for a Sweep.
# Family method after Jacob Small's "Create profile family from curves" (Export-Profile-Family, Computational Dynamics),
# rewritten for CPython3 and the Revit API directly: no Dynamo geometry, so no unit conversion questions.
# Profile: closed loop of detail lines on the template's Ref. Level plan; origin = the point of focus (field edge at pitch
# level); X runs away from the field, Y is up. Treads and risers, the slab underside and the leg wall, exactly as Sightline draws them.
# Inputs: IN[0] workbook (.xlsx)  IN[1] Profile.rft  IN[2] save folder  IN[3] family name prefix  IN[4] load into the project
import clr, os, re, uuid, zipfile
import xml.etree.ElementTree as ET
clr.AddReference('RevitAPI')
from Autodesk.Revit.DB import (IFamilyLoadOptions, SaveAsOptions, FilteredElementCollector, ViewPlan, View, ViewType,
                               Transaction, Line, XYZ, Family)
clr.AddReference('RevitServices')
from RevitServices.Persistence import DocumentManager
from RevitServices.Transactions import TransactionManager

MM = 1.0 / 304.8                       # Revit works in feet; the workbook is in mm
NS = '{http://schemas.openxmlformats.org/spreadsheetml/2006/main}'
RID = '{http://schemas.openxmlformats.org/officeDocument/2006/relationships}id'


class Stop(Exception):
    pass


def col_of(ref):
    n = 0
    for ch in ref:
        if not ch.isalpha():
            break
        n = n * 26 + ord(ch.upper()) - 64
    return n - 1


def read_xlsx(p):
    """Every sheet as a list of rows, read with the standard library (no Excel needed)."""
    with zipfile.ZipFile(p) as z:
        names = set(z.namelist())
        shared = []
        if 'xl/sharedStrings.xml' in names:
            for si in ET.fromstring(z.read('xl/sharedStrings.xml')).iter(NS + 'si'):
                shared.append(''.join(t.text or '' for t in si.iter(NS + 't')))
        rels = {r.get('Id'): r.get('Target') for r in ET.fromstring(z.read('xl/_rels/workbook.xml.rels'))}
        book = {}
        for sh in ET.fromstring(z.read('xl/workbook.xml')).iter(NS + 'sheet'):
            t = (rels.get(sh.get(RID)) or '').replace('\\', '/')
            t = t[1:] if t.startswith('/') else (t if t.startswith('xl/') else 'xl/' + t)
            if t not in names:
                continue
            rows = []
            for row in ET.fromstring(z.read(t)).iter(NS + 'row'):
                vals = []
                for c in row.iter(NS + 'c'):
                    i = col_of(c.get('r')) if c.get('r') else len(vals)
                    while len(vals) < i:
                        vals.append(None)
                    typ, v = c.get('t'), c.find(NS + 'v')
                    if typ == 's':
                        val = shared[int(v.text)]
                    elif typ == 'inlineStr':
                        val = ''.join(x.text or '' for x in c.iter(NS + 't'))
                    elif typ in ('str', 'e'):
                        val = v.text if v is not None else ''
                    else:
                        val = float(v.text) if v is not None and v.text not in (None, '') else None
                    vals.append(val)
                rows.append(vals)
            book[sh.get('name')] = rows
    return book


def num(v):
    try:
        return float(v)
    except (TypeError, ValueError):
        return None


def profiles(book):
    """-> [(tier, side, [(x mm, z mm), ...])] from the 'T1 E profile' sheets, in tier order."""
    out = []
    for name, rows in book.items():
        m = re.match(r'^T(\d+) (.+) profile$', name.strip())
        if not m:
            continue
        pts = [(num(r[1]), num(r[2])) for r in rows[1:] if len(r) >= 3 and num(r[1]) is not None and num(r[2]) is not None]
        if len(pts) >= 3:
            out.append((int(m.group(1)), m.group(2).strip(), pts))
    out.sort(key=lambda p: (p[0], p[1]))
    return out


def clean_name(s):
    return re.sub(r'[\\/:*?"<>|]+', '-', s).strip()


class LoadOptions(IFamilyLoadOptions):
    __namespace__ = 'SightlineProfiles_' + uuid.uuid4().hex   # CPython3: a fresh .NET type name on every run
    def OnFamilyFound(self, familyInUse, overwriteParameterValues):
        return True                                            # replace a family of the same name
    def OnSharedFamilyFound(self, sharedFamily, familyInUse, source, overwriteParameterValues):
        return True


def profile_view(fdoc):
    for v in FilteredElementCollector(fdoc).OfClass(ViewPlan):
        if not v.IsTemplate:
            return v                                           # the Ref. Level plan of the profile template
    for v in FilteredElementCollector(fdoc).OfClass(View):
        if not v.IsTemplate and v.ViewType in (ViewType.FloorPlan, ViewType.CeilingPlan, ViewType.DraftingView):
            return v
    raise Stop('The template has no plan view to draw the profile in. Use the Profile.rft family template.')


def make_family(app, doc, tmpl, folder, fname, pts, load):
    fdoc = app.NewFamilyDocument(tmpl)
    try:
        view = profile_view(fdoc)
        tol = app.ShortCurveTolerance * 1.05
        xyz = []
        for x, z in pts:
            p = XYZ(x * MM, z * MM, 0)
            if not xyz or p.DistanceTo(xyz[-1]) > tol:
                xyz.append(p)
        if xyz[0].DistanceTo(xyz[-1]) <= tol:
            xyz.pop()
        if len(xyz) < 3:
            raise Stop('%s: the profile has fewer than three points.' % fname)
        t = Transaction(fdoc, 'Sightline profile')
        t.Start()
        for i in range(len(xyz)):
            fdoc.FamilyCreate.NewDetailCurve(view, Line.CreateBound(xyz[i], xyz[(i + 1) % len(xyz)]))   # closed loop
        t.Commit()
        path = os.path.join(folder, fname + '.rfa')
        so = SaveAsOptions()
        so.OverwriteExistingFile = True
        fdoc.SaveAs(path, so)
        loaded = None
        if load:
            TransactionManager.Instance.ForceCloseTransaction()
            try:
                loaded = fdoc.LoadFamily(doc, LoadOptions())   # replaces an earlier load of the same name
            except Exception:
                tr = Transaction(doc, 'Load Sightline profile')
                tr.Start()
                doc.LoadFamily(path)
                tr.Commit()
                loaded = fname
        return path, len(xyz), loaded
    finally:
        fdoc.Close(False)


def run():
    xlsx, tmpl, folder = IN[0], IN[1], IN[2]
    prefix = clean_name(str(IN[3] or 'Stadium_Bowl_Profile')) or 'Stadium_Bowl_Profile'
    load = bool(IN[4]) if len(IN) > 4 else True
    if not xlsx or not os.path.isfile(str(xlsx)):
        raise Stop('1. Pick the workbook from Sightline (Deliver > Revit package (.zip)).')
    if not tmpl or not os.path.isfile(str(tmpl)) or not str(tmpl).lower().endswith('.rft'):
        raise Stop('2. Pick the profile family template, e.g. C:\\ProgramData\\Autodesk\\RVT 2024\\Family Templates\\English_I\\Profile.rft '
                   '(metric: ...\\English\\Metric Profile.rft).')
    if not folder or not os.path.isdir(str(folder)):
        raise Stop('3. Pick a folder to save the profile families in.')
    try:
        book = read_xlsx(str(xlsx))
    except Exception as e:
        raise Stop('Could not read the workbook: %s' % e)
    profs = profiles(book)
    if not profs:
        raise Stop('No "T1 E profile" sheets in this workbook. Download the Revit package again from the current Sightline.')
    # one family per tier when every side has the same profile; otherwise one per tier and side
    tiers = {}
    for tier, side, pts in profs:
        tiers.setdefault(tier, []).append((side, pts))
    jobs = []
    for tier in sorted(tiers):
        sides = tiers[tier]
        key = lambda p: tuple((round(x, 1), round(z, 1)) for x, z in p)
        if len(set(key(p) for s, p in sides)) == 1:
            jobs.append(('%s_T%d' % (prefix, tier), sides[0][1], 'Tier %d, all sides' % tier))
        else:
            seen = {}
            for side, pts in sides:
                k = key(pts)
                if k in seen:
                    seen[k][2].append(side)
                    continue
                seen[k] = ['%s_T%d_%s' % (prefix, tier, clean_name(side)), pts, [side]]
            for nm, pts, ss in seen.values():
                jobs.append((nm if len(ss) == 1 else nm + '_' + '-'.join(ss[1:]), pts, 'Tier %d, %s' % (tier, ', '.join(ss))))
    doc = DocumentManager.Instance.CurrentDBDocument
    app = DocumentManager.Instance.CurrentUIApplication.Application
    if load and doc.IsFamilyDocument:
        load = False
    report, fams = [], []
    for fname, pts, label in jobs:
        try:
            path, n, loaded = make_family(app, doc, str(tmpl), str(folder), fname, pts, load)
            report.append('%s: %s (%d lines)%s' % (label, path, n, ', loaded' if loaded else ''))
            if loaded is not None and isinstance(loaded, Family):
                fams.append(loaded)
        except Stop as s:
            report.append(str(s))
        except Exception as e:
            report.append('%s: failed - %s' % (fname, e))
    report.append('Next: in a Sweep, pick the point-of-focus boundary (the red field-edge line) as the path and load or pick the family as the profile; its origin is the point of focus, so it sits at its true distance from the field. Flip it if it faces the field.')
    return report, fams


try:
    OUT = run()
except Stop as s:
    OUT = [str(s)], []
# ----------------------------------------
result = Watch(sightline_profile_families)
